# Grasshopper definition main.gh (Grasshopper 1.0.8)
# plug-ins: RhinoCodePluginGH

geo = Geometry([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])
builder = Python3Script(
    script={MarshGuids=True, MarshInputs=True, MarshOutputs=True, Text="cHJpbnQgKCJIRUxMTyIp", Title="builder.py", Uri="file:///C:/Users/bsh96/Documents/GitHub/urban__auto_mass/builder.py", Taxon="*.*.python"},
    block_regions=geo,
    set_back_dist=Slider(5, range=0..10),
    min_width=Slider(20, range=0..100),
    max_width=Slider(45, range=0..100),
    min_dist_between_buildings=Slider(9, range=0..10),
    floor_height="4.0",
    min_floor=Slider(5, range=0..10),
    max_floor=Slider(45, range=0..100),
    GFA="500000",
    building_depth=Slider(18, range=0..100),
    reset=Button())  # -> out, rails, skeletons, buildings, building_breps
geo_2 = Geometry(builder.rails)
geo_3 = Geometry(builder.building_breps)
geo_4 = Geometry(builder.buildings)
panel = Panel(builder.out)
